# Dynamo graph Renombrar parámetro de familia.dyn "Renombrar parámetros" (Dynamo 2.3.0.5885)

code_block = CodeBlock()
# ---------- code_block.designscript (22 lines) ----------
"Casework";
"Ceilings";
"Columns";
"Curtain Panels";
"Curtain Wall Mullions";
"Detail Items";
"Doors";
"Floors";
"Furniture";
"Generic Models";
"Planting";
"Plumbing Fixtures";
"Railings";
"Ramps";
"Site";
"Specialty Equipment";
"Stairs";
"Structural Columns";
"Structural Framing";
"Topography";
"Walls";
"Windows";
# ----------------------------------------
list_create = List.Create(item0=code_block.out0, item1=code_block.out1, item2=code_block.out2, item3=code_block.out3, item4=code_block.out4, item5=code_block.out5, item6=code_block.out6, item7=code_block.out7, item8=code_block.out8, item9=code_block.out9, item10=code_block.out10, item11=code_block.out11, item12=code_block.out12, item13=code_block.out13, item14=code_block.out14, item15=code_block.out15, item16=code_block.out16, item17=code_block.out17, item18=code_block.out18, item19=code_block.out19, item20=code_block.out20, item21=code_block.out21)
byName = Category.ByName(name=list_create)
all_elements_of_category = ElementsOfCategory(Category=byName)
elementType = Element.ElementType(element=all_elements_of_category)
string = StringInput("Keynote")
getParameterValueByName = Element.GetParameterValueByName(element=elementType, parameterName=string)
string_from_object = FromObject(obj=getParameterValueByName)
code_block_2 = CodeBlock { "ARQ1-"; "ARQ1-"; ""; }
replace = String.Replace(str=string_from_object, searchFor=code_block_2.out1, replaceWith=code_block_2.out2)
watch = Watch(replace)
add = code_block_2.out0 + replace
setParameterByName = Element.SetParameterByName(element=elementType, parameterName=string, value=add)
code_block_3 = CodeBlock()
# ---------- code_block_3.designscript (6 lines) ----------
Nota:

El script se debe ejecutar en modo manual (no automática)

Se debe agregar las categorías que qplique a
la prmera lista (List Create);
# ----------------------------------------
watch_2 = Watch(elementType)
watch_3 = Watch(string_from_object)
watch_4 = Watch(add)
